# Dynamo graph 3DGridLines_20210324.dyn (Dynamo 2.0.3.8810)

code_block = CodeBlock { "Generic Models"; }
byName = Category.ByName(name=code_block)
all_elements_of_category = ElementsOfCategory(Category=byName)
grid = Custom[Rename.Grid](element=all_elements_of_category)  # Rename 3D Grid
