# Dynamo custom node RenameGridv1.dyf "Rename.Grid" (Dynamo 2.0.3.8810)
# category: Slava
# Rename 3D Grid

element = Input(element: var)
code_block = CodeBlock { "Level"; }
code_block_2 = CodeBlock { "Work Plane"; }
getParameterValueByName = Element.GetParameterValueByName(element=element, parameterName=code_block_2)
code_block_3 = CodeBlock { 0; }
getItemAtIndex = List.GetItemAtIndex(list=getParameterValueByName, index=code_block_3)
string = StringInput(":")
split = String.Split(str=getItemAtIndex, separater0=string)
code_block_4 = CodeBlock { 1; }
getItemAtIndex_2 = List.GetItemAtIndex(list=split, index=code_block_4)
setParameterByName = Element.SetParameterByName(element=element, parameterName=code_block, value=getItemAtIndex_2)
code_block_5 = CodeBlock { "Grid"; }
code_block_6 = CodeBlock { "Grids"; }
byName = Category.ByName(name=code_block_6)
all_elements_of_category = ElementsOfCategory(Category=byName)
curve = Grid.Curve(grid=all_elements_of_category)
startPoint = Curve.StartPoint(curve=curve)
Y = Point.Y(point=startPoint)
create = List.Create(item0=element)
flatten = List.Flatten(list=create)
python_script = Python(IN[0]=flatten)
# ---------- python_script.python (117 lines) ----------
import clr
import math
clr.AddReference('RevitAPI')
from Autodesk.Revit.DB import *

clr.AddReference("RevitNodes")
import Revit
clr.ImportExtensions(Revit.GeometryConversion)

items = UnwrapElement(IN[0])

def GetCurvePoints(curve):
	return curve.GetEndPoint(0).ToPoint(), curve.GetEndPoint(1).ToPoint()

def GetLocation(item):
	# returns the following properties:
	# [0] point
	# [1] curve
	# [2] is point?
	# [3] is curve?
	# [4] has location?
	# [5] rotation angle
	# [6] has rotation?
	# [7] is curve loop?
	# [8] curve loop
	
	# default values
	point = None
	curveendpoints = None
	curve = None
	ispoint = False
	iscurve = False
	haslocation = False
	rotationangle = None
	hasrotation = False
	iscurveloop = False
	curveloop = None
	# template for return statements:
	# return point, curveendpoints, curve, ispoint, iscurve, haslocation, rotationangle, hasrotation, iscurveloop, curveloop
	
	# points and text notes
	if hasattr(item, "Coord"): 
		return item.Coord.ToPoint(), curveendpoints, curve, True, iscurve, True, rotationangle, hasrotation, iscurveloop, curveloop
	# stair runs and landings
	if hasattr(item, "GetFootprintBoundary"):
		footprint = [x.ToProtoType() for x in item.GetFootprintBoundary()]
		return point, curveendpoints, curve, ispoint, iscurve, True, rotationangle, hasrotation, True, footprint
	# grids, dimensions and boundary segments
	elif hasattr(item, "Curve"): 
		return point, GetCurvePoints(item.Curve), item.Curve.ToProtoType(), ispoint, True, True, rotationangle, hasrotation, iscurveloop, curveloop
	# curtain grid lines
	elif hasattr(item, "FullCurve"): 
		return point, GetCurvePoints(item.FullCurve), item.FullCurve.ToProtoType(), ispoint, True, True, rotationangle, hasrotation, iscurveloop, curveloop
	# curves
	elif hasattr(item, "GetEndpoint"): 
		return point, GetCurvePoints(item), item.ToProtoType(), ispoint, True, True, rotationangle, hasrotation, iscurveloop, curveloop
	# railings and top rails
	elif hasattr(item, "GetPath"):
		railpath = [x.ToProtoType() for x in item.GetPath()]
		# paths with multiple segments
		if len(railpath) > 1: return point, curveendpoints, curve, ispoint, iscurve, True, rotationangle, hasrotation, True, railpath
		# paths with a single segment
		else: return point, GetCurvePoints(railpath[0].ToRevitType()), railpath[0], ispoint, True, True, rotationangle, hasrotation, iscurveloop, curveloop
	# openings
	elif hasattr(item, "BoundaryCurves"):
		# rectangular openings
		# ToDo: find a good way of returning the boundary as a curve loop
		# for now, return defaults in this case
		if item.IsRectBoundary:
			return point, curveendpoints, curve, ispoint, iscurve, haslocation, rotationangle, hasrotation, iscurveloop, curveloop
		# none-rectangular openings
		else: 
			openingloop = [x.ToProtoType() for x in item.BoundaryCurves]
			return point, curveendpoints, curve, ispoint, iscurve, True, rotationangle, hasrotation, True, openingloop
	# extrusion roofs
	elif hasattr(item, "GetProfile"):
		sketchloop = [x.GeometryCurve.ToProtoType() for x in item.GetProfile()]
		return point, curveendpoints, curve, ispoint, iscurve, True, rotationangle, hasrotation, True, sketchloop
	# other elements
	elif hasattr(item, "Location"):
		loc = item.Location
		if loc:
			# line-based elements (e.g. walls)
			if loc.ToString() == 'Autodesk.Revit.DB.LocationCurve':
				return point, GetCurvePoints(loc.Curve), loc.Curve.ToProtoType(), ispoint, True, True, rotationangle, hasrotation, iscurveloop, curveloop
			# point-based elements (e.g. most loadable families)
			elif loc.ToString() == 'Autodesk.Revit.DB.LocationPoint':
				if hasattr(loc, "Rotation"):
					rotationangle = math.degrees(loc.Rotation)
					hasrotation = True
				return loc.Point.ToPoint(), curveendpoints, curve, True, iscurve, True, rotationangle, hasrotation, iscurveloop, curveloop
			# some elements have a location property but don't return curves or points
			else:
				# sketch-based elements (e.g. floor slabs)
				try:
					sketchloop = []
					for ref in HostObjectUtils.GetTopFaces(item):
						boundaryloops = item.GetGeometryObjectFromReference(ref).GetEdgesAsCurveLoops()
						for loop in boundaryloops:
							sketchloop.append([x.ToProtoType() for x in loop])
					return point, curveendpoints, curve, ispoint, iscurve, True, rotationangle, hasrotation, True, sketchloop
				# other elements we can't process
				# return defaults in these cases
				except:
					return point, curveendpoints, curve, ispoint, iscurve, haslocation, rotationangle, hasrotation, iscurveloop, curveloop
		# some elements (e.g.groups, curtain panels etc.)  have a location property which only returns a NoneType
		# return defaults in these cases
		else: return point, curveendpoints, curve, ispoint, iscurve, haslocation, rotationangle, hasrotation, iscurveloop, curveloop
	# in all other cases return defaults
	else: return point, curveendpoints, curve, ispoint, iscurve, haslocation, rotationangle, hasrotation, iscurveloop, curveloop

locations = [GetLocation(x) for x in items]

# Transpose and remove NoneTypes
OUT = []
for prop in map(list, zip(*locations)):
	OUT.append(filter(lambda x: x!=None, prop))
# ----------------------------------------
code_block_7 = CodeBlock(seq=python_script) { seq[0]; seq[1]; seq[2]; seq[3]; seq[4]; seq[5]; seq[6]; seq[7]; seq[8]; seq[9]; }
endPoint = Curve.EndPoint(curve=code_block_7.out2)
Y_2 = Point.Y(point=endPoint)
code_block_8 = CodeBlock { 0; }
getItemAtIndex_3 = List.GetItemAtIndex(list=Y_2, index=code_block_8)
python_script_2 = Python(IN[0]=Y, IN[1]=getItemAtIndex_3)
# ---------- python_script_2.python (17 lines) ----------
import clr
clr.AddReference('ProtoGeometry')
from Autodesk.DesignScript.Geometry import *
#The inputs to this node will be stored as a list in the IN variables.
dataEnteringNode = IN

w = IN[0]
y = IN[1]
a = []

for i in w:
	if i == y:
		a.append(True)
	else:
		a.append(False)

OUT = a
# ----------------------------------------
filterByBoolMask = List.FilterByBoolMask(list=all_elements_of_category, mask=python_script_2)
code_block_9 = CodeBlock { "Name"; }
getParameterValueByName_2 = Element.GetParameterValueByName(element=filterByBoolMask.in, parameterName=code_block_9)
setParameterByName_2 = Element.SetParameterByName(element=element, parameterName=code_block_5, value=getParameterValueByName_2)
