# Dynamo graph Auto_Insert__Pipe_Sleeves_20201208.dyn (Dynamo 2.0.3.8810)

# group: Select Sleeve Family
family_types = FamilyTypes(index=139)

code_block = CodeBlock { "Pipes"; }
byName = Category.ByName(name=code_block)
all_elements_of_category = ElementsOfCategory(Category=byName)

# group: Filter "vertical" vs "horizontal"
code_block_2 = CodeBlock { "Slope"; }
getParameterValueByName = Element.GetParameterValueByName(element=all_elements_of_category, parameterName=code_block_2)
code_block_3 = CodeBlock { ""; }
eq = getParameterValueByName == code_block_3
filterByBoolMask = List.FilterByBoolMask(list=all_elements_of_category, mask=eq)

# group: Get Floors From The Background File
getDocuments = archilab.Revit.Selection.Select.GetDocuments()
code_block_4 = CodeBlock(x=getDocuments.Link_Doc) { x[0]; }
code_block_5 = CodeBlock { "Floors"; }
byName_2 = Category.ByName(name=code_block_5)
get_all_elements_from_linked = Custom[Get All Elements From Linked Model](linkDoc=code_block_4, category=byName_2)  # This node is based on code posted by Julien Benoit. Big thanks to Julien for sharing his work. This node will retrieve all elements of a given category from a given linked model.

# group: Pipes and Floors Intersections
geometry = Element.Geometry(element=filterByBoolMask.in)
flatten = List.Flatten(list=geometry)
geometry_2 = Element.Geometry(element=get_all_elements_from_linked)
flatten_2 = List.Flatten(list=geometry_2)
intersect = Geometry.Intersect(geometry=flatten@L2, other=flatten_2)

isEmpty = List.IsEmpty(list=intersect)
allTrue = List.AllTrue(list=isEmpty)
filterByBoolMask_2 = List.FilterByBoolMask(list=intersect, mask=allTrue)
boolean = BoolSelector(false)
clean = List.Clean(list=filterByBoolMask_2.out, preserveIndices=boolean)
flatten_3 = List.Flatten(list=clean)

# group: Point Where we Insert Sleeves
centroid = Solid.Centroid(solid=flatten_3)

byPoint = FamilyInstance.ByPoint(familyType=family_types, point=centroid)
