# Dynamo graph Conduit_Check_If_Param_Filled_Out_20201130.dyn (Dynamo 2.0.3.8810)

code_block = CodeBlock { "Conduits"; }
byName = Category.ByName()  # unwired: name
all_elements_of_category = ElementsOfCategory()  # unwired: Category
boolean = BoolSelector(true)
ꟿ_collect_currentselection = Custom[ꟿ Collect.CurrentSelection](refresh=boolean)  # Gets the currently selected elements. Connect a boolean switch to refresh the selection.
code_block_2 = CodeBlock { "Going To"; }
getParameterValueByName = Element.GetParameterValueByName(element=ꟿ_collect_currentselection, parameterName=code_block_2)
code_block_3 = CodeBlock { ""; }
eq = getParameterValueByName == code_block_3
filterByBoolMask = List.FilterByBoolMask(list=ꟿ_collect_currentselection, mask=eq)
string = StringInput("Going To")
code_block_4 = CodeBlock { "?"; }
setParameterByName = Element.SetParameterByName(element=filterByBoolMask.in, parameterName=string, value=code_block_4)
