# Dynamo graph Conduit_LengthAndBendCount_20201013.dyn (Dynamo 2.0.3.8810)

boolean = BoolSelector(false)
ꟿ_collect_currentselection = Custom[ꟿ Collect.CurrentSelection](refresh=boolean)  # Gets the currently selected elements. Connect a boolean switch to refresh the selection.

# group: Filter out "fitting" vs "conduit"
code_block = CodeBlock { "Length"; }
getParameterValueByName = Element.GetParameterValueByName(element=ꟿ_collect_currentselection, parameterName=code_block)
code_block_2 = CodeBlock { ""; }
eq = getParameterValueByName == code_block_2

filterByBoolMask = List.FilterByBoolMask(list=ꟿ_collect_currentselection, mask=eq)

# group: Overbend check
max_bend_degrees = IntegerSlider(180, range=0..360 step 90)
code_block_3 = CodeBlock { "Angle"; }
getParameterValueByName_2 = Element.GetParameterValueByName(element=filterByBoolMask.in, parameterName=code_block_3)
sum = Math.Sum(values=getParameterValueByName_2)
code_block_4 = CodeBlock(a=max_bend_degrees, sum=sum) { a; sum >= a; }
code_block_5 = CodeBlock { "Overbend"; ""; }
if_ = If(test=code_block_4.out1, true=code_block_5.out0, false=code_block_5.out1)

# group: Filter out conduit runs with overbends vs normal conduits
string = StringInput("Comments")
setParameterByName = Element.SetParameterByName(element=ꟿ_collect_currentselection, parameterName=string, value=if_)
code_block_6 = CodeBlock { "Comments"; }
getParameterValueByName_3 = Element.GetParameterValueByName(element=setParameterByName, parameterName=code_block_6)
code_block_7 = CodeBlock { "Overbend"; }
contains = String.Contains(str=getParameterValueByName_3, searchFor=code_block_7)

filterByBoolMask_2 = List.FilterByBoolMask(list=setParameterByName, mask=contains)

# group: Overlength check
string_2 = StringInput("Comments")
max_length_feet = IntegerSlider(150, range=0..200 step 50)
code_block_8 = CodeBlock { "Length"; }
getParameterValueByName_4 = Element.GetParameterValueByName(element=filterByBoolMask_2.out, parameterName=code_block_8)
code_block_9 = CodeBlock { ""; }
eq_2 = getParameterValueByName_4 == code_block_9
filterByBoolMask_3 = List.FilterByBoolMask(list=filterByBoolMask_2.out, mask=eq_2)
code_block_10 = CodeBlock { "Length"; }
getParameterValueByName_5 = Element.GetParameterValueByName(element=filterByBoolMask_3.out, parameterName=code_block_10)
sum_2 = Math.Sum(values=getParameterValueByName_5)
code_block_11 = CodeBlock(b=max_length_feet, sum=sum_2) { b; sum >= b; }
code_block_12 = CodeBlock { "Overlength"; "Normal"; }
if_2 = If(test=code_block_11.out1, true=code_block_12.out0, false=code_block_12.out1)
setParameterByName_2 = Element.SetParameterByName(element=filterByBoolMask_2.out, parameterName=string_2, value=if_2)

# group: Overbend and Overlength check
string_3 = StringInput("Comments")
max_length_feet_2 = IntegerSlider(150, range=0..200 step 50)
code_block_13 = CodeBlock { "Length"; }
getParameterValueByName_6 = Element.GetParameterValueByName(element=filterByBoolMask_2.in, parameterName=code_block_13)
code_block_14 = CodeBlock { ""; }
eq_3 = getParameterValueByName_6 == code_block_14
filterByBoolMask_4 = List.FilterByBoolMask(list=filterByBoolMask_2.in, mask=eq_3)
code_block_15 = CodeBlock { "Length"; }
getParameterValueByName_7 = Element.GetParameterValueByName(element=filterByBoolMask_4.out, parameterName=code_block_15)
sum_3 = Math.Sum(values=getParameterValueByName_7)
code_block_16 = CodeBlock(b=max_length_feet_2, sum=sum_3) { b; sum >= b; }
code_block_17 = CodeBlock { "Overbend and Overlength"; "Overbend"; }
if_3 = If(test=code_block_16.out1, true=code_block_17.out0, false=code_block_17.out1)
setParameterByName_3 = Element.SetParameterByName(element=filterByBoolMask_2.in, parameterName=string_3, value=if_3)
