# Dynamo graph Duct_Placing_Damper_Families_At_Intersections_Of_Duct_And_Wall.dyn (Dynamo 2.0.3.8810)

code_block = CodeBlock { "Ducts"; }
byName = Category.ByName(name=code_block)
all_elements_of_category = ElementsOfCategory(Category=byName)
code_block_2 = CodeBlock { "Slope"; }
getParameterValueByName = Element.GetParameterValueByName(element=all_elements_of_category, parameterName=code_block_2)
code_block_3 = CodeBlock { ""; }
eq = getParameterValueByName == code_block_3
filterByBoolMask = List.FilterByBoolMask(list=all_elements_of_category, mask=eq)

# group: Round and Rectangular Ducts
code_block_4 = CodeBlock { "Diameter"; }
getParameterValueByName_2 = Element.GetParameterValueByName(element=filterByBoolMask.out, parameterName=code_block_4)
code_block_5 = CodeBlock { ""; }
equals = List.Equals(objectA=getParameterValueByName_2@L1, objectB=code_block_5)
filterByBoolMask_2 = List.FilterByBoolMask(list=filterByBoolMask.in, mask=equals)

geometry = Element.Geometry(element=filterByBoolMask_2.in)
flatten = List.Flatten(list=geometry)

# group: Get stuff from a linked file
getDocuments = archilab.Revit.Selection.Select.GetDocuments()
code_block_6 = CodeBlock(x=getDocuments.Link_Doc) { x[0]; }
code_block_7 = CodeBlock { "Walls"; }
byName_2 = Category.ByName(name=code_block_7)
get_all_elements_from_linked = Custom[Get All Elements From Linked Model](linkDoc=code_block_6, category=byName_2)  # This node is based on code posted by Julien Benoit. Big thanks to Julien for sharing his work. This node will retrieve all elements of a given category from a given linked model.

geometry_2 = Element.Geometry(element=get_all_elements_from_linked)
flatten_2 = List.Flatten(list=geometry_2)
intersect = Geometry.Intersect(geometry=flatten@L1, other=flatten_2)
isEmpty = List.IsEmpty(list=intersect@L2)
allTrue = List.AllTrue(list=isEmpty@L2)
filterByBoolMask_3 = List.FilterByBoolMask(list=filterByBoolMask_2.in, mask=allTrue)
filterByBoolMask_4 = List.FilterByBoolMask(list=intersect, mask=allTrue)
boolean = BoolSelector(false)
clean = List.Clean(list=filterByBoolMask_4.out, preserveIndices=boolean)
flatten_3 = List.Flatten(list=clean)
centroid = Solid.Centroid(solid=flatten_3)
family_types = FamilyTypes()  # nothing selected
code_block_8 = CodeBlock { "Duct Width"; "Duct Height"; }
insertDamper = archilab.Revit.Elements.Ducts.InsertDamper(duct=filterByBoolMask_3.out, point=centroid, damperType=family_types, damperWidth=code_block_8.out0, damperHeight=code_block_8.out1)
