# Dynamo graph GridLines_20210128.dyn (Dynamo 2.0.3.8810)

family_types = FamilyTypes(index=2)
byCoordinates = Point.ByCoordinates()
flatten = List.Flatten(lacing=Shortest)  # unwired: list
byPoint = FamilyInstance.ByPoint()  # unwired: familyType, point
eq = _ == _  # unwired: x, y
code_block = CodeBlock { "Generic Models"; }
byName = Category.ByName(name=code_block)
all_elements_of_category = ElementsOfCategory(Category=byName)
code_block_2 = CodeBlock { "Grid"; }
getParameterValueByName = Element.GetParameterValueByName(element=all_elements_of_category, parameterName=code_block_2)
code_block_3 = CodeBlock { "Length"; }
getParameterValueByName_2 = Element.GetParameterValueByName(element=all_elements_of_category, parameterName=code_block_3)
code_block_4 = CodeBlock { "Grid"; }
code_block_5 = CodeBlock { "Grids"; }
byName_2 = Category.ByName(name=code_block_5)
all_elements_of_category_2 = ElementsOfCategory(Category=byName_2)
curve = Grid.Curve(grid=all_elements_of_category_2)
startPoint = Curve.StartPoint(curve=curve)
Y = Point.Y(point=startPoint)
location = Custom[Element.Location+](element=all_elements_of_category)  # Returns the location of an element as point, curve or curve loop, along with some booleans to help filtering the results. Unlike the OOTB Element.GetLocation node, it also retunrs sketch lines of sketch-based elements like floor slabs as well as the element's rotation property.
endPoint = Curve.EndPoint(curve=location.curves)
Y_2 = Point.Y(point=endPoint)
code_block_6 = CodeBlock { 0; }
getItemAtIndex = List.GetItemAtIndex(list=Y_2, index=code_block_6)
python_script = Python(IN[0]=Y, IN[1]=getItemAtIndex)
# ---------- python_script.python (17 lines) ----------
import clr
clr.AddReference('ProtoGeometry')
from Autodesk.DesignScript.Geometry import *
#The inputs to this node will be stored as a list in the IN variables.
dataEnteringNode = IN

w = IN[0]
y = IN[1]
a = []

for i in w:
	if i == y:
		a.append(True)
	else:
		a.append(False)

OUT = a
# ----------------------------------------
filterByBoolMask = List.FilterByBoolMask(list=all_elements_of_category_2, mask=python_script)
code_block_7 = CodeBlock { "Name"; }
getParameterValueByName_3 = Element.GetParameterValueByName(element=filterByBoolMask.in, parameterName=code_block_7)
setParameterByName = Element.SetParameterByName(element=all_elements_of_category, parameterName=code_block_4, value=getParameterValueByName_3)
allIndicesOf = List.AllIndicesOf()  # unwired: list, item
X = Point.X(point=endPoint)
setIntersection = List.SetIntersection()  # unwired: list1, list2
code_block_8 = CodeBlock()  # unwired: a
# ---------- code_block_8.designscript (10 lines) ----------
a;
c = [Imperative]
{
if(a == 1)
{return = true;
}
else{
return = false;
}
};
# ----------------------------------------
code_block_9 = CodeBlock { "Name"; }
getParameterValueByName_4 = Element.GetParameterValueByName(element=all_elements_of_category_2, parameterName=code_block_9)
code_block_10 = CodeBlock { ""; }
eq_2 = getParameterValueByName_4 == code_block_10
id = Element.Id(element=all_elements_of_category)
