# Dynamo graph OBJ_export.dyn (Dynamo 2.0.3.8810)

code_block = CodeBlock { "C:\\Users\\slava.krel\\Desktop\\test"; }
code_block_2 = CodeBlock { 1; ".obj"; }
add = code_block + code_block_2.out0
add_2 = add + code_block_2.out1
categories = Categories(index=131)
all_elements_of_category = ElementsOfCategory(Category=categories)
solids = Element.Solids(element=all_elements_of_category)
flatten = List.Flatten(list=solids)
byUnion = Solid.ByUnion(solids=flatten)
byGeometry = Autodesk.Dynamo.MeshToolkit.Mesh.ByGeometry(inputGeometry=byUnion)
exportMeshes = Autodesk.Dynamo.MeshToolkit.Mesh.ExportMeshes(filename=add_2, meshes=byGeometry)
