# Dynamo custom node RenameGrid.dyf (Dynamo 2.0.3.8810)
# category: Slava
# Rename 3D GridLines

element = Input(element: var)
location = Custom[Element.Location+](element=element)  # Returns the location of an element as point, curve or curve loop, along with some booleans to help filtering the results. Unlike the OOTB Element.GetLocation node, it also retunrs sketch lines of sketch-based elements like floor slabs as well as the element's rotation property.
endPoint = Curve.EndPoint(curve=location.curves)
X = Point.X(point=endPoint)
code_block = CodeBlock { "Grid"; }
code_block_2 = CodeBlock { "Grids"; }
byName = Category.ByName(name=code_block_2)
all_elements_of_category = ElementsOfCategory(Category=byName)
curve = Grid.Curve(grid=all_elements_of_category)
startPoint = Curve.StartPoint(curve=curve)
Y = Point.Y(point=startPoint)
Y_2 = Point.Y(point=endPoint)
code_block_3 = CodeBlock { 0; }
getItemAtIndex = List.GetItemAtIndex(list=Y_2, index=code_block_3)
python_script = Python(IN[0]=Y, IN[1]=getItemAtIndex)
# ---------- python_script.python (17 lines) ----------
import clr
clr.AddReference('ProtoGeometry')
from Autodesk.DesignScript.Geometry import *
#The inputs to this node will be stored as a list in the IN variables.
dataEnteringNode = IN

w = IN[0]
y = IN[1]
a = []

for i in w:
	if i == y:
		a.append(True)
	else:
		a.append(False)

OUT = a
# ----------------------------------------
filterByBoolMask = List.FilterByBoolMask(list=all_elements_of_category, mask=python_script)
code_block_4 = CodeBlock { "Name"; }
getParameterValueByName = Element.GetParameterValueByName(element=filterByBoolMask.in, parameterName=code_block_4)
setParameterByName = Element.SetParameterByName(element=element, parameterName=code_block, value=getParameterValueByName)
code_block_5 = CodeBlock { "Length"; }
getParameterValueByName_2 = Element.GetParameterValueByName(element=element, parameterName=code_block_5)
code_block_6 = CodeBlock { "Grid"; }
getParameterValueByName_3 = Element.GetParameterValueByName(element=element, parameterName=code_block_6)
id = Element.Id(element=element)
code_block_7 = CodeBlock { "Name"; }
getParameterValueByName_4 = Element.GetParameterValueByName(element=all_elements_of_category, parameterName=code_block_7)
code_block_8 = CodeBlock { ""; }
eq = getParameterValueByName_4 == code_block_8
