# Dynamo graph Selecting all elements in a conduit run.dyn (Dynamo 2.0.4.12684)

select_model_element = DSModelElementSelection()  # 1 picked in the model
# note: Provides a list of all elements connected to the selected element
python_script = Python(IN[0]=select_model_element)
# ---------- python_script.python (75 lines) ----------
import clr
import math

clr.AddReference("RevitServices")
import RevitServices
from RevitServices.Persistence import DocumentManager
from RevitServices.Transactions import TransactionManager
doc = DocumentManager.Instance.CurrentDBDocument

clr.AddReference("RevitAPI")
import Autodesk
from Autodesk.Revit.DB import *

clr.AddReference("RevitNodes")
import Revit
clr.ImportExtensions(Revit.Elements)
clr.ImportExtensions(Revit.GeometryConversion)
#The inputs to this node will be stored as a list in the IN variables.
if isinstance(IN[0],list):
	element = UnwrapElement(IN[0])
	toggle = 0
else:
	element = [UnwrapElement(IN[0])]
	toggle = 1
		
def nextElements(elem):
	listout = []
	try:
		connectors = elem.ConnectorManager.Connectors
	except:
		connectors = elem.MEPModel.ConnectorManager.Connectors
	for conn in connectors:
		for c in conn.AllRefs:
			if c.Owner.Id.Equals(elem.Id):
				continue
			elif c.Owner.GetType() == Mechanical.MechanicalSystem:
				continue
			else:
				newelem = c.Owner
			listout.append(newelem)
	return listout

def systemcheck(elem):
	if elem.GetType() == Mechanical.MechanicalSystem or elem.GetType() == Plumbing.PipingSystem:
		return True
	else:
		return False
	
def collector(elem):
	cont = 0
	for x in nextElements(elem):
		if x.Id in lookup:
			cont += 1
		else:
			item = doc.GetElement(x.Id)
			if systemcheck(item):
				return elem
			else:
				lookup[x.Id] = item
				collector(x)
	if cont == len(nextElements(elem)):
		return elem
		

listout = []
for x in element:
	lookup = {}
	collector(x)
	listout.append(lookup.values())

#Assign your output to the OUT variable.
if toggle:
	OUT = lookup.values()
else:
	OUT = listout
# ----------------------------------------
